vi "index.gviweb"   [G Web Development Software 22.0.0]
panel controls:
  "stop": bool
  "Start": bool
panel indicators:
  "endring": f64
  "Nivå (%)": f64
  "LED": bool
  "Nivå (%)": f64
  "Power Button": bool
  "HH": bool
  "URL Image": string
  "URL Image_2": string
  "URL Image_3": string
  "URL Image_4": string
  "URL Image_5": string
  "H": bool
  "LED_2": bool
diagram:
  $Start <- FALSE
  # Place setup code before the loop. For example, perform initial data communication and wire the results into the loop.
  # Place setup code before the loop. For example, perform initial data communication and wire the results into the loop.
  # Top-Level WebVIs usually contain a While Loop that never stops so that they can continue running as long as the web page is open in the user's web browser.
  while {
    # Top-Level WebVIs usually contain a While Loop that never stops so that they can continue running as long as the web page is open in the user's web browser.
    case ($Start) {
      frame False, Default { }
      frame True {
        s1 = 0  # shift register
        while {
          Add(s1, $endring) -> w1
          $"Nivå (%)" <- w1
          $"Nivå (%)" <- w1
          Is Less(x=w1, y=80) -> w2
          $H <- w2
          Is Less(x=w1, y=95) -> w3
          $"Power Button" <- w3
          $LED_2 <- w3
          $HH <- w3
          Select(s=w3, t=2, f=0) -> w4
          $endring <- w4
          Wait(time to wait=500)
          $LED <- w2
          next s1 = w1
          stop if $stop
        }
      }
    }
    $"Nivå (%)" <- 0
    $endring <- 10
    stop if FALSE
  }
